# Grasshopper definition 01_EditFacadeMaterial.gh (Grasshopper 1.0.7)
# Copyright: Coprat
# plug-ins: dfenvimet

# df_envimet
# 
# How to edit wall material for detailed building models.
# Example of a green wall.
# 
# Requirements:
# - df_envimet components (June version)
# - Ladybug
# 
# Author: Antonello Di Nunzio
# Last update: 2021 01 04
ladybug = Ladybug_Ladybug()  # -> Vviiiiiiiiiizzz; plug-in component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
crv = Curve(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)
constructlocation = Ladybug_ConstructLocation(locationName="Example", latitude="41.5609753", longitude="14.6593308", timeZone="+1", elevation=0)  # -> location; plug-in component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
brep = Brep(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)
boundary = BoundarySurfaces(Edges=crv)
srf = Surface(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)
dfenvimetlocation = DFEnvimetLocation(_location=constructlocation, ModelRotation_=0, ReferenceLongitude_=15)
dfenvimetbuildings = DFEnvimetBuildings(_geometry=brep, SimplifiedCalculation_=False)
dfenvimetgrid = DFEnvimetGrid(
    _baseSurface=boundary,
    StartTelescopeHeight_=5,
    DimX_=3,
    DimY_=3,
    DimZ_=3,
    AddCellsLeft_=2,
    AddCellslRight_=2,
    AddCellsUp_=2,
    AddCellsDown_=2,
    NumCellsZ_="23",
    CombineGridType_=False)
dfenvimetmanageworkspace = DFEnvimetManageWorkspace(_workspaceFolder="C:\Example", _projectName_="df_envimet")
dfenvimet2dplant = DFEnvimet2dPlant(_plant2D=srf)

# ---- group: 1
toggle = BooleanToggle(False)

# ----
dfenvimetspaces = DFEnvimetSpaces(
    _envimetFolder=dfenvimetmanageworkspace,
    _envimetLocation=dfenvimetlocation,
    _envimentGrid=dfenvimetgrid,
    _envimentObjects_=flatten([dfenvimetbuildings, dfenvimet2dplant]),
    FileName_="DragonflyEnvimet",
    _runIt=toggle,
    ViewGrid_=toggle)  # -> ModelInfo, XYGrid, XZGrid, YZGrid, INXfileAddress

# ---- group: Edit material - Post processing / 2
toggle_2 = BooleanToggle(False)

# ---- group: Edit material - Post processing / 4
toggle_3 = BooleanToggle(False)

# ---- group: Edit material - Post processing
# 3. Select mesh facades in Rhino canvas
# (highlighted in yellow)
crv_2 = Curve(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)
dfreadfacade = DFEnvimetReadFacade(
    _INXfileAddress=dfenvimetspaces.INXfileAddress,
    EnvimentGrid_=dfenvimetgrid,
    RunIt_=toggle_2,
    Bake_=toggle_2,
    Curve_=crv_2)
dfreadlibrary = DFEnvimetReadLibrary(_selectMaterial="greening")  # -> GreeningId, Description, XML
item = ListItem(List=dfreadlibrary.GreeningId, Index=0, Wrap=True)
dfeditfacadematerials = DFEditFacadeMaterials(_INXfileAddress=dfenvimetspaces.INXfileAddress, Material_=item, Greening_=Toggle(True), _runIt=toggle_3)

# ---- group: 5
toggle_4 = BooleanToggle(False)

# ----
panel = Panel(dfeditfacadematerials)
dfenvimetruninx = DFEnvimetRunINX(_INXfileAddress=dfeditfacadematerials, _runIt=toggle_4)

# ---- group: Simulation file settings / 6
toggle_5 = BooleanToggle(False)

# ---- group: Simulation file settings
series = Series(Start=0, Step=1, Count="24")
graph = GraphMapper(series, x0=0, x1=24, y0=15, y1=23, container_name="Gaussian", factor=0.7422582507, mean=0.5402690768, sdev=0.3290909678)
graph_2 = GraphMapper(series, x0=0, x1=24, y0=65, y1=45, container_name="Gaussian", factor=0.7422582507, mean=0.5402690768, sdev=0.3290909678)
item_2 = ListItem(List=graph, Index="5", Wrap=True)
dfenvimetconfigsimpleforcing = DFEnvimetConfigSimpleForcing(_dryBulbTemperature=graph, _relativeHumidity=graph_2)
dfenvimetconfigmainsettings = DFEnvimetConfigMainSettings(
    _simName="green_wall_simulation",
    _INXfileAddress=dfeditfacadematerials,
    StartDate_="21.06.2018",
    StartTime_="06:00:00",
    SimDuration_=24,
    WindSpeed_=3,
    WindDirection_=0,
    Roughness_=0.01,
    InitialTemperature_=item_2,
    SpecificHumidity_=7,
    RelativeHumidity_=50)
dfenvimetconfig = DFEnvimetConfig(_mainSettings=dfenvimetconfigmainsettings, OtherSettings_=dfenvimetconfigsimpleforcing, _runIt=toggle_5)

# ---- group: Run Simulation / 7
toggle_6 = BooleanToggle(False)

# ---- group: Run Simulation
dfenvimetrunsimulation = DFEnvimetRunSimulation(_envimetFolder=dfenvimetmanageworkspace, _SIMXfileAddress=dfenvimetconfig, _type_=True, _runIt=toggle_6)
