# Grasshopper definition 02_RunMultipleSimulation.gh (Grasshopper 1.0.7)
# Copyright: Coprat
# plug-ins: dfenvimet

# df_envimet
# 
# How to run multiple simulation
# 
# Requirements:
# - df_envimet components (June version)
# - Ladybug
# 
# Author: Antonello Di Nunzio
# Last update: 2021 01 04
ladybug = Ladybug_Ladybug()  # -> Vviiiiiiiiiizzz; plug-in component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
crv = Curve(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)
constructlocation = Ladybug_ConstructLocation(locationName="Example", latitude="41.5609753", longitude="14.6593308", timeZone="+1", elevation=0)  # -> location; plug-in component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
brep = Brep(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)
boundary = BoundarySurfaces(Edges=crv)
srf = Surface(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)
dfenvimetlocation = DFEnvimetLocation(_location=constructlocation, ModelRotation_=0, ReferenceLongitude_=15)
dfenvimetbuildings = DFEnvimetBuildings(_geometry=brep, SimplifiedCalculation_=False)
dfenvimetgrid = DFEnvimetGrid(
    _baseSurface=boundary,
    StartTelescopeHeight_=5,
    DimX_="4",
    DimY_="4",
    DimZ_="4",
    AddCellsLeft_=2,
    AddCellslRight_=2,
    AddCellsUp_=2,
    AddCellsDown_=2,
    NumCellsZ_="21",
    CombineGridType_=False)
dfenvimetmanageworkspace = DFEnvimetManageWorkspace(_workspaceFolder="C:\Example", _projectName_="df_envimet")
dfenvimet2dplant = DFEnvimet2dPlant(_plant2D=srf)

# ---- group: 1
toggle = BooleanToggle(False)

# ----
dfenvimetspaces = DFEnvimetSpaces(
    _envimetFolder=dfenvimetmanageworkspace,
    _envimetLocation=dfenvimetlocation,
    _envimentGrid=dfenvimetgrid,
    _envimentObjects_=flatten([dfenvimetbuildings, dfenvimet2dplant]),
    FileName_="DragonflyEnvimet",
    _runIt=toggle,
    ViewGrid_=toggle)  # -> ModelInfo, XYGrid, XZGrid, YZGrid, INXfileAddress

dfenvimetruninx = DFEnvimetRunINX(_INXfileAddress=dfenvimetspaces.INXfileAddress, _runIt=Toggle(False))

# ---- group: 2 - customize it and set it to True
series = Series(Start=0, Step=1, Count="24")
graph = GraphMapper(series, x0=0, x1=24, y0=15, y1=23, container_name="Gaussian", factor=0.7422582507, mean=0.5402690768, sdev=0.3290909678)
graph_2 = GraphMapper(series, x0=0, x1=24, y0=65, y1=45, container_name="Gaussian", factor=0.7422582507, mean=0.5402690768, sdev=0.3290909678)
item = ListItem(List=graph, Index="5", Wrap=True)
dfenvimetconfigsimpleforcing = DFEnvimetConfigSimpleForcing(_dryBulbTemperature=graph, _relativeHumidity=graph_2)
dfenvimetconfigmainsettings = DFEnvimetConfigMainSettings(
    _simName="simulation_wind_0",
    _INXfileAddress=dfenvimetspaces.INXfileAddress,
    StartDate_="21.06.2018",
    StartTime_="06:00:00",
    SimDuration_=24,
    WindSpeed_=3,
    WindDirection_="0",
    Roughness_=0.01,
    InitialTemperature_=item,
    SpecificHumidity_=7,
    RelativeHumidity_=50)
dfenvimetconfig = DFEnvimetConfig(_mainSettings=dfenvimetconfigmainsettings, OtherSettings_=dfenvimetconfigsimpleforcing, _runIt=Toggle(False))
panel = Panel(dfenvimetconfig)

# ---- group: 3 - customize it and set it to True
dfenvimetconfigsimpleforcing_2 = DFEnvimetConfigSimpleForcing(_dryBulbTemperature=graph, _relativeHumidity=graph_2)
dfenvimetconfigmainsettings_2 = DFEnvimetConfigMainSettings(
    _simName="simulation_wind_90",
    _INXfileAddress=dfenvimetspaces.INXfileAddress,
    StartDate_="21.06.2018",
    StartTime_="06:00:00",
    SimDuration_=24,
    WindSpeed_=3,
    WindDirection_="90",
    Roughness_=0.01,
    InitialTemperature_=item,
    SpecificHumidity_=7,
    RelativeHumidity_=50)
dfenvimetconfig_2 = DFEnvimetConfig(_mainSettings=dfenvimetconfigmainsettings_2, OtherSettings_=dfenvimetconfigsimpleforcing_2, _runIt=Toggle(False))
panel_2 = Panel(dfenvimetconfig_2)

# ---- group: 4 - customize it and set it to True
dfenvimetconfigsimpleforcing_3 = DFEnvimetConfigSimpleForcing(_dryBulbTemperature=graph, _relativeHumidity=graph_2)
dfenvimetconfigmainsettings_3 = DFEnvimetConfigMainSettings(
    _simName="simulation_wind_180",
    _INXfileAddress=dfenvimetspaces.INXfileAddress,
    StartDate_="21.06.2018",
    StartTime_="06:00:00",
    SimDuration_=24,
    WindSpeed_=3,
    WindDirection_="180",
    Roughness_=0.01,
    InitialTemperature_=item,
    SpecificHumidity_=7,
    RelativeHumidity_=50)
dfenvimetconfig_3 = DFEnvimetConfig(_mainSettings=dfenvimetconfigmainsettings_3, OtherSettings_=dfenvimetconfigsimpleforcing_3, _runIt=Toggle(False))
panel_3 = Panel(dfenvimetconfig_3)

# ---- group: 6
toggle_2 = BooleanToggle(False)

# ----
number_slider = Slider(0, range=0..2)
fly = Ladybug_fly(inputSliders=number_slider, fly=toggle_2)  # -> Vviiiiiiiiiizzz; plug-in component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

item_2 = ListItem(List=[dfenvimetconfig, dfenvimetconfig_2, dfenvimetconfig_3], Index=number_slider, Wrap=True)

# ---- group: 5
toggle_3 = BooleanToggle(False)

# ----
# Close the first float window.
# Wait LB fly.
dfenvimetrunsimulation = DFEnvimetRunSimulation(_envimetFolder=dfenvimetmanageworkspace, _SIMXfileAddress=item_2, _type_=True, _runIt=toggle_3)
