# Grasshopper definition 03_ReadingResults.gh (Grasshopper 1.0.7)
# Copyright: Coprat
# plug-ins: dfenvimet

# You can also connect the full path of the envimet output folder
python = GhPythonScript()  # -> output_folder
# ---------- python: Python ----------
"""Get current path - for examples only"""

__author__ = "antonellodinunzio"

import os

file_name = ghenv.Component.OnPingDocument().FilePath

output_folder = os.path.join(os.path.dirname(file_name), "output")
# ---------- end python ----------
# df_envimet
# 
# How to read envimet output
# 
# Requirements:
# - df_envimet components (June version)
# - Ladybug (LBT)
# 
# Author: Antonello Di Nunzio
# Last update: 2021 01 04
# Read binary results
# You can also usea panel with the full path of the INX model
python_2 = GhPythonScript()  # -> inx_file
# ---------- python_2: Python ----------
"""Get current path - for examples only"""

__author__ = "antonellodinunzio"

import os

file_name = ghenv.Component.OnPingDocument().FilePath

inx_file = os.path.join(os.path.dirname(file_name), "DragonflyEnvimet.INX")
# ---------- end python_2 ----------
# 2
# Right click on it to select the sub-folder to read
dfgridfolder = DFEnvimetGridFolder(_outputFolder=python)  # -> GridFiles, GridBinaryFiles, Type
# 1
# Right click and select 'Facade Output'
dfbuildingfiles = DFEnvimetBuildingFiles(_outputFolder=python)  # -> BuildingFiles, BuildingBinaryFiles

# ---- group: Select the EDT/EDX to read
# 3
number_slider = Slider(0, range=0..1)

# ----
item = ListItem(List=dfbuildingfiles.BuildingFiles, Index=number_slider, Wrap=True)
item_2 = ListItem(List=dfbuildingfiles.BuildingBinaryFiles, Index=number_slider, Wrap=True)

item_3 = ListItem(List=dfgridfolder.GridFiles, Index=number_slider, Wrap=True)
item_4 = ListItem(List=dfgridfolder.GridBinaryFiles, Index=number_slider, Wrap=True)

# ----
# 4
toggle = BooleanToggle(False)
select_the_variable_by_index = Panel("7")
dfreadgridresults = DFEnvimetReadGridResults(
    _gridFiles=item_3,
    _gridBinaryFiles=item_4,
    _type=dfgridfolder.Type,
    _variable_=select_the_variable_by_index,
    _z_=0,
    RunIt_=toggle)  # -> Report, Vector, FileName, VariableName, AnalysisResult
# Click on X or Y or Z
dfreadgrid = DFEnvimetReadGrid(_INXfileAddress=python_2, RunIt_=toggle)

# ----
# 5
toggle_2 = BooleanToggle(False)
select_the_variable_by_index_2 = Panel("10")
dfreadbuildingfacaderesults = DFEnvimetReadBuildingFacadeResults(_buildingFiles=item, _buildingBinaryFiles=item_2, _variable_=select_the_variable_by_index_2, RunIt_=toggle_2)  # -> FileName, VariableName, AnalysisResult
# Click on X or Y or Z
dfreadfacade = DFEnvimetReadFacade(_INXfileAddress=python_2, RunIt_=toggle_2, Bake_=False)

# ---- group: Geometry
entwine = Entwine(Branch00=dfreadgrid, Branch01=dfreadfacade, FlattenInputs=True)

# ---- group: Values
# 6
entwine_2 = Entwine(Branch00=dfreadgridresults.AnalysisResult, Branch01=dfreadbuildingfacaderesults.AnalysisResult, FlattenInputs=True)

# ----
flatten = FlattenTree(Tree=entwine_2, Path="{0}")

pt = Point(Point(165.5011485, -1.535729754, 0))
bnd = Bounds(Numbers=flatten)
colrange = LBColorRange(index="15")  # -> colors; plug-in component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
dedomain = DeconstructDomain(Domain=bnd)  # -> Start, End
legendpar = LBLegendParameters(min=dedomain.Start, max=dedomain.End, colors=colrange, base_plane=pt)  # -> leg_par; plug-in component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

heatmap = LBSpatialHeatmap(values=entwine_2, mesh=entwine, legend_par=legendpar)  # -> mesh, legend, title, colors, legend_par; plug-in component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

bang = ExplodeTree(Data=heatmap.legend)
data = Data(heatmap.mesh)
