# Grasshopper definition 03_ModelAsinkTerrain.gh (Grasshopper 1.0.7)
# Copyright: Coprat
# plug-ins: dfenvimet

# df_envimet
# 
# How to model a sink terrain
# 
# Requirements:
# - df_envimet components (June version)
# - Ladybug
# 
# Author: Antonello Di Nunzio
# Last update: 2021 01 29
ladybug = Ladybug_Ladybug()  # -> Vviiiiiiiiiizzz; plug-in component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
constructlocation = Ladybug_ConstructLocation(locationName="Example", latitude="41.5609753", longitude="14.6593308", timeZone="+1", elevation=0)  # -> location; plug-in component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
crv = Curve(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)
brep = Brep(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)

# ---- group: Terrain
brep_2 = Brep(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)
dfenvimetterrain = DFEnvimetTerrain(_terrain=brep_2)  # -> EnvimetTerrain, Geometry

# ---- group: River
brep_3 = Brep(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)
dfenvimetsoil = DFEnvimetSoil(_soil=brep_3, _profileId_="0100WW")

# ----
boundary = BoundarySurfaces(Edges=crv)
srf = Surface([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])
dfenvimetbuildings = DFEnvimetBuildings(_geometry=brep, SimplifiedCalculation_=False)
dfenvimetlocation = DFEnvimetLocation(_location=constructlocation, ModelRotation_=0, ReferenceLongitude_=15)
dfenvimetgrid = DFEnvimetGrid(
    _baseSurface=boundary,
    StartTelescopeHeight_=5,
    DimX_=3,
    DimY_=3,
    DimZ_=3,
    AddCellsLeft_=2,
    AddCellslRight_=2,
    AddCellsUp_=2,
    AddCellsDown_=2,
    NumCellsZ_="23",
    CombineGridType_=False)
dfenvimetmanageworkspace = DFEnvimetManageWorkspace(_workspaceFolder="C:\Example", _projectName_="df_envimet")
dfenvimet2dplant = DFEnvimet2dPlant(_plant2D=srf)

# ---- group: 1
toggle = BooleanToggle(False)

# ----
dfenvimetspaces = DFEnvimetSpaces(
    _envimetFolder=dfenvimetmanageworkspace,
    _envimetLocation=dfenvimetlocation,
    _envimentGrid=dfenvimetgrid,
    _envimentObjects_=flatten([dfenvimetbuildings, dfenvimet2dplant, dfenvimetterrain.EnvimetTerrain, dfenvimetsoil]),
    FileName_="DragonflyEnvimet",
    _runIt=toggle,
    ViewGrid_=toggle)  # -> ModelInfo, XYGrid, XZGrid, YZGrid, INXfileAddress
dfenvimetruninx = DFEnvimetRunINX(_INXfileAddress=dfenvimetspaces.INXfileAddress, _runIt=Toggle(False))
