# Grasshopper definition 04_CustomGreenMaterial.gh (Grasshopper 1.0.7)
# Copyright: Coprat
# plug-ins: dfenvimet

# df_envimet
# 
# Apply custom green material to the building
# 
# Requirements:
# - df_envimet components (June version)
# - Ladybug
# 
# Author: Antonello Di Nunzio
# Last update: 2021 10 21
ladybug = Ladybug_Ladybug()  # -> Vviiiiiiiiiizzz; plug-in component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
crv = Curve(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)
constructlocation = Ladybug_ConstructLocation(locationName="Example", latitude="41.5609753", longitude="14.6593308", timeZone="+1", elevation=0)  # -> location; plug-in component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
boundary = BoundarySurfaces(Edges=crv)
python = GhPythonScript()  # -> folder
# ---------- python: Python ----------
"""Get current path - for examples only"""

__author__ = "antonellodinunzio"

import os
file_name = ghenv.Component.OnPingDocument().FilePath
folder = os.path.join(os.path.dirname(file_name), "Example")
if not os.path.isdir(folder):
    os.mkdir(folder)
# ---------- end python ----------
srf = Surface(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)
# 1. Create your custom material first with Envimet
panel = Panel("23")
dfenvimetlocation = DFEnvimetLocation(_location=constructlocation, ModelRotation_=0, ReferenceLongitude_=15)
dfenvimetgrid = DFEnvimetGrid(
    _baseSurface=boundary,
    StartTelescopeHeight_=5,
    DimX_=3,
    DimY_=3,
    DimZ_=3,
    AddCellsLeft_=2,
    AddCellslRight_=2,
    AddCellsUp_=2,
    AddCellsDown_=2,
    NumCellsZ_=panel,
    CombineGridType_=False)
dfenvimetmanageworkspace = DFEnvimetManageWorkspace(_workspaceFolder=python, _projectName_="df_envimet")
dfenvimet2dplant = DFEnvimet2dPlant(_plant2D=srf)
dfreadlibrary = DFEnvimetReadLibrary(_selectMaterial="greening", EnvimetFolder_=dfenvimetmanageworkspace)  # -> GreeningId, Description, XML
panel_2 = Panel(dfreadlibrary.Description)
item = ListItem(List=dfreadlibrary.GreeningId, Index=0, Wrap=True)
brep = Brep(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)
dfenvimetbuildings = DFEnvimetBuildings(_geometry=brep, GreenWallMaterial_=item, SimplifiedCalculation_=False)

# ---- group: 2
toggle = BooleanToggle(False)

# ----
dfenvimetspaces = DFEnvimetSpaces(
    _envimetFolder=dfenvimetmanageworkspace,
    _envimetLocation=dfenvimetlocation,
    _envimentGrid=dfenvimetgrid,
    _envimentObjects_=flatten([dfenvimetbuildings, dfenvimet2dplant]),
    FileName_="DragonflyEnvimet",
    _runIt=toggle,
    ViewGrid_=toggle)  # -> ModelInfo, XYGrid, XZGrid, YZGrid, INXfileAddress

# ---- group: 3
toggle_2 = BooleanToggle(False)

# ----
dfenvimetruninx = DFEnvimetRunINX(_INXfileAddress=dfenvimetspaces.INXfileAddress, _runIt=toggle_2)
