# Grasshopper definition 05_CreateComplexBuilding.gh (Grasshopper 1.0.7)
# Copyright: Coprat
# plug-ins: dfenvimet

# df_envimet
# 
# Create a complex buildings made by "zones".
# 
# Requirements:
# - df_envimet components (June version)
# - Ladybug
# 
# Author: Antonello Di Nunzio
# Last update: 2021 10 21
ladybug = Ladybug_Ladybug()  # -> Vviiiiiiiiiizzz; plug-in component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
constructlocation = Ladybug_ConstructLocation(locationName="Example", latitude="41.5609753", longitude="14.6593308", timeZone="+1", elevation=0)  # -> location; plug-in component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

# ---- group: 1
# Select solid breps
myzones = Brep([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])

# ----
crv = Curve(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)
boundary = BoundarySurfaces(Edges=crv)
python = GhPythonScript()  # -> folder
# ---------- python: Python ----------
"""Get current path - for examples only"""

__author__ = "antonellodinunzio"

import os
file_name = ghenv.Component.OnPingDocument().FilePath
folder = os.path.join(os.path.dirname(file_name), "Example")
if not os.path.isdir(folder):
    os.mkdir(folder)
# ---------- end python ----------
dfreadlibrary = DFEnvimetReadLibrary(_selectMaterial="wall")  # -> WallMaterialOrRoofMaterial, Description, XML
dfenvimetlocation = DFEnvimetLocation(_location=constructlocation, ModelRotation_=0, ReferenceLongitude_=15)
dfenvimetgrid = DFEnvimetGrid(
    _baseSurface=boundary,
    StartTelescopeHeight_=5,
    DimX_="2",
    DimY_="2",
    DimZ_="2",
    AddCellsLeft_=2,
    AddCellslRight_=2,
    AddCellsUp_=2,
    AddCellsDown_=2,
    NumCellsZ_="28",
    CombineGridType_=False)
dfenvimetmanageworkspace = DFEnvimetManageWorkspace(_workspaceFolder=python, _projectName_="df_envimet")

# ---- group: Get random materials
jitter = Jitter(List=dfreadlibrary.WallMaterialOrRoofMaterial, Jitter=1, Seed=2)  # -> Values, Indices
lng = ListLength(List=myzones)
jitter_2 = Jitter(List=jitter.Values, Jitter=1, Seed=2)  # -> Values, Indices
split = SplitList(List=jitter.Values, Index=lng)  # -> ListA, ListB
split_2 = SplitList(List=jitter_2.Values, Index=lng)  # -> ListA, ListB

# ---- group: buildings
dfenvimetbuildings = DFEnvimetBuildings(_geometry=myzones, WallMaterial_=split.ListA, RoofMaterial_=split_2.ListA, SimplifiedCalculation_=False)

# ---- group: 2
toggle = BooleanToggle(False)

# ----
dfenvimetspaces = DFEnvimetSpaces(
    _envimetFolder=dfenvimetmanageworkspace,
    _envimetLocation=dfenvimetlocation,
    _envimentGrid=dfenvimetgrid,
    _envimentObjects_=flatten(dfenvimetbuildings),
    FileName_="DragonflyEnvimet",
    _runIt=toggle,
    ViewGrid_=toggle)  # -> ModelInfo, XYGrid, XZGrid, YZGrid, INXfileAddress

# ---- group: 3
toggle_2 = BooleanToggle(False)

# ----
your_inx_model_is_here_continue_with_env = Panel(dfenvimetspaces.INXfileAddress)  # "Your INX model is here! Continue with ENVIMET"
dfenvimetruninx = DFEnvimetRunINX(_INXfileAddress=dfenvimetspaces.INXfileAddress, _runIt=toggle_2)
